# Grasshopper definition builder_test.gh (Grasshopper 1.0.8)
# plug-ins: Selva

types = ValueList({"Sphere": 0, "Cylinder": 1, "Box": 2}, selected="Box")
radius = Slider(7, range=0..20)
heigth = Slider(10, range=10..20)
width = Slider(10, range=10..20)
ui_bridge = UIBridge(
    Enable=Toggle(True),
    Schema="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",
    SessionId="m0iEJ-Cv",
    Values="{\"4a7cf1b2-03d2-4894-97b3-c2da6d9209a9\":\"Box\",\"819a5bc3-2d58-4d65-b3fc-31626472385d\":10,\"12e4b4b9-2767-426b-baa5-0a0e1bcd0a5b\":7,\"e62a2ebe-2158-41c4-bf95-b31c862c5257\":\"false\",\"d5efe509-6e2e-4b83-bfdb-6ad50bc31001\":10}")  # -> SessionID, Info, Schema
context_print = ContextPrint(Schema=ui_bridge.Schema)
copy_up = GetBoolean("false", AtLeast=1, AtMost=1, FalseValue="False", TreeAccess=False, TrueValue="True")
radius_2 = GetNumber(radius, AtLeast=1, AtMost=1, Maximum=25, Minimum=5, TreeAccess=False)
width_2 = GetNumber(heigth, AtLeast=1, AtMost=1, Maximum=20, Minimum=5, TreeAccess=False)
heigth_2 = GetNumber(width, AtLeast=1, AtMost=1, Maximum=20, Minimum=5, TreeAccess=False)
get_value_list = GetValueList(
    types,
    AtLeast=1,
    AtMost=1,
    Immediate=True,
    StoredItems="""[
  {
    "name": "Sphere",
    "expression": "0"
  },
  {
    "name": "Cylinder",
    "expression": "1"
  },
  {
    "name": "Box",
    "expression": "2"
  }
]""",
    TreeAccess=False)
cylinder = Cylinder(Base=PlaneXY(0, 0, 0), Radius=radius_2, Length=heigth_2)
sphere = Sphere(Base=PlaneXY(0, 0, 0), Radius=radius_2)
center_box = CenterBox(Base=PlaneXY(0, 0, 0), X=radius_2, Y=width_2, Z=heigth_2)
cap_holes = CapHoles(Brep=cylinder)
stream_filter = StreamFilter(Gate=get_value_list, Stream0=sphere, Stream1=cap_holes, Stream2=center_box)
bounding_box = BoundingBox(Content=stream_filter, Plane=PlaneXY(0, 0, 0))  # -> Box, Box_2
deconstruct_box = DeconstructBox(Box=bounding_box.Box)  # -> Plane, X, Y, Z
unit_z = UnitZ(Factor=deconstruct_box.Z)
move = Move(Geometry=stream_filter, Motion=unit_z)  # -> Geometry, Transform
merge = Merge(Data1=stream_filter, Data2=move.Geometry)  # -> flatten(Result)
stream_filter_2 = StreamFilter(Gate=copy_up, Stream0=stream_filter, Stream1=merge)
mesh = Mesh(<mesh referenced from the Rhino model>)
mesh_2 = Mesh([<mesh referenced from the Rhino model> x28])
mesh_3 = Mesh([<mesh referenced from the Rhino model> x26])
mesh_4 = Mesh([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])
material_color = ColourSwatch(SwatchColor=RGB(199, 165, 165))
material_color_2 = ColourSwatch(SwatchColor=RGB(199, 165, 165))
three_material = ThreeMaterial(Color=material_color, Metalness="0.95", Roughness="0.25", Opacity=1, Transparent=False)
three_material_2 = ThreeMaterial(Color=material_color_2, Metalness="0.95", Roughness="0.25", Opacity=1, Transparent=False)
display = Display(Geo=mesh, ThreeMaterial=three_material_2)
display_2 = Display(Geo=mesh_2, ThreeMaterial=three_material_2)
display_3 = Display(Geo=mesh_3, ThreeMaterial=three_material_2)
display_4 = Display(Geo=mesh_4, ThreeMaterial=three_material_2)
display_5 = Display(Geo=stream_filter_2, ThreeMaterial=three_material)
geometry_to_file = GeometryToFile(Geometry=stream_filter_2, FileNames="Test", FileEnding=".3dm")
area = Area(Geometry=stream_filter_2)  # -> Area, Centroid
merge_2 = Merge(Data1=display, Data2=display_2, Data3=display_3, Data4=display_4)
display_6 = ContextBake(Content=merge_2)
bake = ContextBake(Content=geometry_to_file)
print = ContextPrint(Print=area.Area)
